# Grasshopper definition 20230206_ComputationDesign_DLA.gh (Grasshopper 1.0.8)

mesh = Mesh(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)
srf = Surface(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)
timer = Timer(Interval=20, TimerInterval=20, Target=python)  # disabled
python = GhPythonScript(iReset=Button(), iMesh=mesh, iChosenFace="612", seed="3842")  # -> oLines, oPoint, pPoint; inputs iReset: Boolean, iMesh: Mesh, iChosenFace: Int32, seed: Int32
# ---------- python: Python ----------
import Rhino.Geometry as rg
import random as r

class DLAMesh:

    def __init__(self, meshbase, indexbase):

        self.MeshBase = meshbase
        self.IndexBase = indexbase

    def ChosenPoint(self):

        cpoint = self.MeshBase.Faces.GetFaceCenter(self.IndexBase)
        return cpoint

    def Neighbors(self, index):

        fcs = self.MeshBase.Faces.AdjacentFaces(index)

        viz = []
        for i in range(len(fcs)): viz.append(fcs[i]) #array to list

        if len(viz) == 2:
            k = self.MeshBase.Faces.AdjacentFaces(viz[0])
            w = self.MeshBase.Faces.AdjacentFaces(viz[1])
            for i in range(len(k)):
                for j in range(len(w)):
                    if k[i] == w[j] and k[i] != index: viz.append(k[i])
                    else: continue

        elif len(viz) == 3:
            k = self.MeshBase.Faces.AdjacentFaces(viz[0])
            w = self.MeshBase.Faces.AdjacentFaces(viz[1])
            z = self.MeshBase.Faces.AdjacentFaces(viz[2])
            for i in range(len(k)):
                for j in range(len(w)):
                    if k[i] == w[j] and k[i] != index: viz.append(k[i])
                    else: continue
            for i in range(len(k)):
                for j in range(len(z)):
                    if k[i] == z[j] and k[i] != index: viz.append(k[i])
                    else: continue
            for i in range(len(z)):
                for j in range(len(w)):
                    if z[i] == w[j] and z[i] != index: viz.append(z[i])
                    else: continue

        elif len(viz) == 4:
            k = self.MeshBase.Faces.AdjacentFaces(viz[0])
            w = self.MeshBase.Faces.AdjacentFaces(viz[1])
            z = self.MeshBase.Faces.AdjacentFaces(viz[2])
            q = self.MeshBase.Faces.AdjacentFaces(viz[3])
            #K
            for i in range(len(k)):
                for j in range(len(w)):
                    if k[i] == w[j] and k[i] != index: viz.append(k[i])
                    else: continue
            for i in range(len(k)):
                for j in range(len(z)):
                    if k[i] == z[j] and k[i] != index: viz.append(k[i])
                    else: continue
            for i in range(len(k)):
                for j in range(len(q)):
                    if k[i] == q[j] and k[i] != index: viz.append(k[i])
                    else: continue
            #W
            for i in range(len(w)):
                for j in range(len(z)):
                    if w[i] == z[j] and w[i] != index: viz.append(w[i])
                    else: continue
            for i in range(len(w)):
                for j in range(len(q)):
                    if w[i] == q[j] and w[i] != index: viz.append(w[i])
                    else: continue
            #Z
            for i in range(len(z)):
                for j in range(len(q)):
                    if z[i] == q[j] and z[i] != index: viz.append(z[i])
                    else: continue

        return viz

    def EdgeFaces(self):

        edgeFaces = []
        for i in range(len(self.MeshBase.Faces)):
            verif = self.Neighbors(i)
            if len(verif) < 8:
                edgeFaces.append(i)
            else:
                continue
        return edgeFaces

    def Direction(self, index):

        pos = self.MeshBase.Faces.GetFaceCenter(index)
        npos = self.Neighbors(index)
        ori = self.ChosenPoint()
        lin0 = rg.Line(pos, ori)
        vec0 = lin0.Direction
        vec0.Unitize()

        vecs = []
        for i in range(len(npos)):
            cpos = iMesh.Faces.GetFaceCenter(npos[i])
            line = rg.Line(pos, cpos)
            vec = line.Direction
            vec.Unitize()
            vecs.append(vec)

        ang = []
        for i in range(len(vecs)):
            ang.append(rg.Vector3d.VectorAngle(vec0, vecs[i]))

        list00 = []
        for i in range(len(ang)):
            list00.append([ang[i], i])
        list00.sort()

        sindex = []
        for i in list00:
            sindex.append(i[1])

        opt = []
        for i in range(3): opt.append(npos[sindex[i]])

        rnum = r.randint(1,100)
        if 0 < rnum <= 50: return opt[0]
        if 50 < rnum <= 80: return opt[1]
        else: return opt[2]

    def Point(self, index):
        Point = self.MeshBase.Faces.GetFaceCenter(index)
        return Point

# Main Script

oLines = []
pPoint = []

if iReset:
    num = iChosenFace
    mesh = DLAMesh(iMesh, num)
    oPoint = mesh.ChosenPoint()
    vnum = mesh.Neighbors(num)
    
    di = {}
    di[num] = 1
    list0 = [num]
    list1 = [list0]
    ver1 = True
    ver2 = True
    k = 0

else:
    k += 1
    if ver1 == True:
        r.seed(k+seed)
        ind = r.choice(mesh.EdgeFaces())
        hist = [ind]
        ver1 = False
        oPoint = mesh.ChosenPoint()
    else:
        oPoint = mesh.ChosenPoint()
        pPoint.append(mesh.Point(ind))
        upd = mesh.Direction(ind)
        ind = upd
        hist.append(ind)
        print hist
        if ind in di:
            ver1 = True
            pt1 = mesh.Point(ind)
            ind = hist[-2]
            pt2 = mesh.Point(ind)
            di[ind] = 1
            line = rg.Line(pt1, pt2)
            oLines.append(line)
# ---------- end python ----------
rec = DataRecorder(python.oLines, DataLimit=-10, RecordData=True)
crv = Curve(rec)
pt = Point(python.oPoint)
pt_2 = Point(python.pPoint)
python_2 = GhPythonScript(iLines=crv, iPoint=pt)  # -> oLines; inputs iLines: list of Line, iPoint: Point3d
# ---------- python_2: Python ----------
import ghpythonlib.treehelpers as th
import Rhino.Geometry as rg
import random as r

di = {}
for i in range(len(iLines)):
    pt = iLines[i].From
    if pt not in di:
        li = []
        for j in range(len(iLines)):
            if pt == iLines[j].From:
                li.append(iLines[j])
            else: continue
        di[pt] = li
    else: continue

pt = iPoint
listl0 = []
listl1 = []
hist = [len(di[pt])]
histpt = [pt]
while pt in di:
    lin = di[pt][0]
    pt = lin.To
    listl0.append(lin)
    if pt in di:
        hist.append(len(di[pt]))
        histpt.append(pt)
    else:
        listl1.append(listl0)
        listl0 = []
        while len(hist) > 0:
            if hist[-1] == 1:
                hist.pop(-1)
                histpt.pop(-1)
            elif hist[-1] > 1:
                hist[-1] -= 1
                di[histpt[-1]].pop(0)
                pt = iPoint
                hist = [len(di[pt])]
                histpt = [pt]
                break

oLines = th.list_to_tree(listl1)
# ---------- end python_2 ----------
join = JoinCurves(Curves=python_2, Preserve=False)  # -> flatten(Curves)
cp = ControlPoints(Curve=join)  # -> Points, Weights, Knots
python_3 = GhPythonScript(iPoly=join, iCP=cp.Points)  # -> oPoly; inputs iPoly: list of GeometryBase, iCP: tree of Point3d
# ---------- python_3: Python ----------
import Rhino.Geometry as rg
import ghpythonlib.treehelpers as th

iCP = th.tree_to_list(iCP)

oPoly = []
for i in range(len(iPoly)):
    if len(iCP[i]) > 5:
        oPoly.append(iPoly[i])
# ---------- end python_3 ----------
disc = Discontinuity(Curve=python_3, Level=1)  # -> Points, Parameters
nurbs = NurbsCurve(Vertices=disc.Points, Degree=3, Periodic=False)  # -> flatten(Curve), Length, Domain
